# Dynamo graph Place_Sections_On_Sheets_Grid.dyn
# author: Muhammad Hindichristine
# Place multiple section views on Revit sheets - FULLY CONNECTED AND READY TO USE

codeBlock = CodeBlock(X=0, Y=0, IsVisible=true, IsUpstreamVisible=true, Excluded=false, HasUI=false, Frozen=false, UsingDefaultValue=false, Name="Sheets Category") { "Sheets"; }
custom = Custom[](InPortData=[{Name: "Category Name", Description: "The built-in category name", TypeName: "string", TypeRank: -1, DefaultValue: "Sheets", DefaultValueEnabled: true}], X=150, Y=0, IsVisible=true, IsUpstreamVisible=true, Excluded=false, HasUI=false, Frozen=false, UsingDefaultValue=false, Name="Get Sheets Category")  # Get a category from the document by name; unwired: Category_Name
custom_2 = Custom[](InPortData=[{Name: "category", Description: "The Category", TypeName: "var", TypeRank: -1, DefaultValue: null, DefaultValueEnabled: false}], X=300, Y=0, IsVisible=true, IsUpstreamVisible=true, Excluded=false, HasUI=false, Frozen=false, UsingDefaultValue=false, Name="All Sheets")  # unwired: category
codeBlock_2 = CodeBlock(X=0, Y=150, IsVisible=true, IsUpstreamVisible=true, Excluded=false, HasUI=false, Frozen=false, UsingDefaultValue=false, Name="Sections Category") { "Section Views"; }
custom_3 = Custom[](InPortData=[{Name: "Category Name", Description: "The built-in category name", TypeName: "string", TypeRank: -1, DefaultValue: "Sheets", DefaultValueEnabled: true}], X=150, Y=150, IsVisible=true, IsUpstreamVisible=true, Excluded=false, HasUI=false, Frozen=false, UsingDefaultValue=false, Name="Get Sections Category")  # unwired: Category_Name
custom_4 = Custom[](InPortData=[{Name: "category", Description: "The Category", TypeName: "var", TypeRank: -1, DefaultValue: null, DefaultValueEnabled: false}], X=300, Y=150, IsVisible=true, IsUpstreamVisible=true, Excluded=false, HasUI=false, Frozen=false, UsingDefaultValue=false, Name="All Section Views")  # unwired: category
codeBlock_3 = CodeBlock(X=450, Y=150, IsVisible=true, IsUpstreamVisible=true, Excluded=false, HasUI=false, Frozen=false, UsingDefaultValue=false, Name="Get Section Names") { sections.Name; }  # unwired: sections
codeBlock_4 = CodeBlock(X=400, Y=250, IsVisible=true, IsUpstreamVisible=true, Excluded=false, HasUI=false, Frozen=false, UsingDefaultValue=false, Name="Filter Keyword") { "Wall"; }
custom_5 = Custom[](X=550, Y=200, IsVisible=true, IsUpstreamVisible=true, Excluded=false, HasUI=false, Frozen=false, UsingDefaultValue=false, Name="String.Contains")  # unwired: str, searchFor, ignoreCase
custom_6 = Custom[](InPortData=[{Name: "list", Description: "A list to filter", TypeName: "var[]", TypeRank: -1, DefaultValue: null, DefaultValueEnabled: false}, {Name: "mask", Description: "A list of booleans representing a mask", TypeName: "var[]", TypeRank: -1, DefaultValue: null, DefaultValueEnabled: false}], X=700, Y=150, IsVisible=true, IsUpstreamVisible=true, Excluded=false, HasUI=false, Frozen=false, UsingDefaultValue=false, Name="Filter Sections by Name")  # unwired: list, mask
codeBlock_5 = CodeBlock(X=450, Y=50, IsVisible=true, IsUpstreamVisible=true, Excluded=false, HasUI=false, Frozen=false, UsingDefaultValue=false, Name="Get First Sheet") { sheets[0]; }  # unwired: sheets
codeBlock_6 = CodeBlock(X=450, Y=400, IsVisible=true, IsUpstreamVisible=true, Excluded=false, HasUI=false, Frozen=false, UsingDefaultValue=false, Name="Pass Config") { config; }  # unwired: config
codeBlock_7 = CodeBlock(X=900, Y=200, IsVisible=true, IsUpstreamVisible=true, Excluded=false, HasUI=false, Frozen=false, UsingDefaultValue=false, Name="Calculate Positions")  # unwired: sections, sheets, config
# ---------- codeBlock_7.designscript (24 lines) ----------
// Calculate grid positions for multiple sections
sectionCount = Count(sections);
maxCols = config.maxCols;
rows = Math.Ceiling(sectionCount / maxCols);

positions = [];
col = 0;
row = 0;

for(i in 0..sectionCount-1)
{
  x = config.startX + (col * config.spacingX);
  y = config.startY - (row * config.spacingY);
  positions = Append(positions, [x, y]);
  col = col + 1;
  
  if(col >= config.maxCols)
  {
    col = 0;
    row = row + 1;
  }
};

positions;
# ----------------------------------------
custom_7 = Custom[](InPortData=[{Name: "x", Description: "x to watch", TypeName: "var[]", TypeRank: -1, DefaultValue: null, DefaultValueEnabled: false}], X=600, Y=50, IsVisible=true, IsUpstreamVisible=true, Excluded=false, HasUI=false, Frozen=false, UsingDefaultValue=false, Name="Selected Sheet")  # unwired: x
codeBlock_8 = CodeBlock(X=300, Y=400, IsVisible=true, IsUpstreamVisible=true, Excluded=false, HasUI=false, Frozen=false, UsingDefaultValue=false, Name="Grid Configuration")
# ---------- codeBlock_8.designscript (7 lines) ----------
{
  startX = 1.0,      // Starting X position (feet)
  startY = 8.0,      // Starting Y position (feet)  
  spacingX = 2.8,    // Horizontal spacing (feet)
  spacingY = 3.8,    // Vertical spacing (feet)
  maxCols = 2        // Max sections per row
};
# ----------------------------------------
custom_8 = Custom[](InPortData=[{Name: "x", Description: "x to watch", TypeName: "var[]", TypeRank: -1, DefaultValue: null, DefaultValueEnabled: false}], X=1100, Y=200, IsVisible=true, IsUpstreamVisible=true, Excluded=false, HasUI=false, Frozen=false, UsingDefaultValue=false, Name="Viewport Positions")  # unwired: x
